# Requirement set ACSRequirements (R2022a)

## 1 [#1] Attitude Control Modes
The CubeSat shall have control logic that can be turned off or on from an input

## 2 [#8] Off Mode (Container)

### 2.1 [#10] Enter Off
Off mode shall be entered when initializing the controller or when navigation has been set to off

### 2.2 [#11] Output upon entering Off Mode
The controller shall output a signal that indicates entering Off mode

### 2.3 [#12] Output in Off Mode
The controller shall output zero torque commands for all 3 axes

## 3 [#9] On Mode (Container)

### 3.1 [#13] Enter On
On mode shall be entered when navigation has been set to Sun tracking mode or Nadir Pointing mode

### 3.2 [#14] Output upon entering On Mode
The controller shall output a signal that indicates entering On mode

### 3.3 [#15] States of On mode
One of three states shall be active when in On mode
- Transition
- Sun Tracking
- Nadir Pointing (Earth)

## 4 [#2] Sun Tracking (Container)

### 4.1 [#3] Enter Sun Tracking from Transition
Sun tracking shall be entered from Transition when navigation has set to Sun tracking

### 4.2 [#4] Output upon entering Sun Tracking
The controller shall output a signal that indicates entering the sun tracking state

### 4.3 [#16] Attitude Error Output
The attitude error relative to a sun tracking position shall be calculated and output

## 5 [#5] Nadir Pointing (Container)

### 5.1 [#6] Enter Nadir Pointing from Transition
Nadir Pointing shall be entered from Transition when navigation has set to Nadir Pointing

### 5.2 [#7] Output upon entering Nadir Pointing
The controller shall output a signal that indicates entering the Nadir Pointing mode

### 5.3 [#17] Attitude Error Output
The attitude error relative to a nadir pointing position shall be calculated and output

## 6 [#18] Transition (Container)

### 6.1 [#19] Enter Transition from Sun Tracking
Transition mode shall be entered from Sun Tracking when navigation has set to Nadir Pointing

### 6.2 [#20] Enter Transition from Nadir Pointing
Transition state shall be entered from Nadir Pointing when navigation has set to Sun Tracking

### 6.3 [#21] Enter Transition for Initializing On mode
Transition state shall be entered when first entering On mode

## 7 [#22] Torque Command
A controller shall calculate torque commands based on the attitude error and navigation mode