% Simulink data dictionary asbCubeSatModelData.sldd

CubeSatTimeStep = 1
visOff = Simulink.Variant(Condition="variantVisualization == 0")
visSL3D = Simulink.Variant(Condition="variantVisualization == 1")
variantVisualization = 1

ACSOutBus = Simulink.Bus()
  AttitudeError: AttitudeErrorBus
  TorqueCmds: double[3]
  cmd_q_b2tgt: double[4]
  NavMode: double

FCSOutBus = Simulink.Bus()
  ACSOut: ACSOutBus

AttitudeErrorBus = Simulink.Bus()
  Roll: double
  Pitch: double
  Yaw: double

EnvBus = Simulink.Bus()
  envAccel_ecef: double[3]
  envForces_body: double[3]
  envTorques_body: double[3]
  x_sun_eci: double[3]
  earthAngRate: double[3]

gains = struct(Kp=5.5e-5, Ki=0, Kd=0.017)
vehicle = struct(mass=1, inertia=[1 0 0; 0 1 0; 0 0 1])

initCond = struct(
  simStartDate=struct(JD=2458666, dateVector=[2019 7 1 11 0 1.3427734375e-5]),
  CoordEpoch=struct(JD=2451545, dateVector=[2000 1 1 12 0 0]),
  OrbitalElements=struct(
    semiMajorAxis=8052000,
    eccentricity=1.0e-10,
    inclination=103.5638,
    RAAN=58,
    argumentOfPerigee=78.46,
    trueAnomoly=287,
    trueLongitude=0,
    argumentOfLatititude=0,
    longitudeOfPerigee=0),
  r_eci=[4399932 6702283 744785.8],
  v_eci=[1038.256 -1438.196 6808.59],
  r_ecef=[7127667 -3669373 752843.3],
  v_ecef=[-1589.815 -1690.861 6810.542],
  lla=[5.393289 -27.23973 1674051],
  v_ned=[6840.506 -2231.024 -3.394409],
  uvw=[6322.226 -3167.15 1329.893],
  euler=[33.8 -5.9 9.88],
  pqr=[0 0 0])

StatesOutBus = Simulink.Bus()
  utc_JD: double
  X_ecef: double[3]
  V_ecef: double[3]
  X_eci: double[3]
  V_eci: double[3]
  q_ecef2b: double[4]
  q_eci2b: double[4]
  Euler: double[3]
  LatLonAlt: double[3]
  SunAngle: double
  SunInView: boolean
  sun_eci: double[3]