% Requirement links of asbCubeSatACS.slx (R2022a)

block :17 implements ACSRequirements.slreqx#22: Torque Command
block :45 implements ACSRequirements.slreqx#1: Attitude Control Modes
block :45:37 implements ACSRequirements.slreqx#15: States of On mode
block :45:40 implements ACSRequirements.slreqx#6: Enter Nadir Pointing from Transition
block :45:40 implements ACSRequirements.slreqx#7: Output upon entering Nadir Pointing
block :45:41 implements ACSRequirements.slreqx#12: Output in Off Mode
block :45:41 implements ACSRequirements.slreqx#10: Enter Off
block :45:51 implements ACSRequirements.slreqx#3: Enter Sun Tracking from Transition
block :45:51 implements ACSRequirements.slreqx#4: Output upon entering Sun Tracking
block :45:53 implements ACSRequirements.slreqx#13: Enter On
block :45:53 implements ACSRequirements.slreqx#14: Output upon entering On Mode
block :45:54 implements ACSRequirements.slreqx#21: Enter Transition for Initializing On mode
block :45:55 implements ACSRequirements.slreqx#19: Enter Transition from Sun Tracking
block :45:56 implements ACSRequirements.slreqx#20: Enter Transition from Nadir Pointing
block :45:6 implements ACSRequirements.slreqx#10: Enter Off
block :45::255 implements ACSRequirements.slreqx#11: Output upon entering Off Mode
block :45::582 implements ACSRequirements.slreqx#16: Attitude Error Output
block :45::631 implements ACSRequirements.slreqx#17
block :45::632 implements ACSRequirements.slreqx#16: Attitude Error Output