% Simulink data dictionary asbCubeSatArchInterfaceData.sldd
% references asbCubeSatModelData.sldd

GNCtoPowerBus = Simulink.Bus()
  InSunView: boolean
  SunAngle: double

altitude = Simulink.Parameter(4000000)
h_table = Simulink.Parameter([0; 200; 500; 750; 1000])
v_table = Simulink.Parameter([-0.5; -10; -75; -100; -100])
ACSConfigSet = Simulink.ConfigSet(StartTime="0", StopTime="86400", FixedStep="CubeSatTimeStep", Solver="FixedStepDiscrete", ProdHWDeviceType="Intel->x86-64 (Windows64)", SystemTargetFile="ert.tlc", TargetLang="C")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
CubeSatConfigSet = Simulink.ConfigSet(StartTime="0", StopTime="86400/6", AbsTol="1e-7", MaxStep="10", RelTol="1e-7", Solver="VariableStepAuto", ProdHWDeviceType="Intel->x86-64 (Windows64)", SystemTargetFile="grt.tlc", TargetLang="C")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