# Requirement set SystemRequirements (R2022a)

## 1 [#1] Provide visual imagery
The system shall provide and store visual imagery of MathWorks headquarters [42.2775 N, 71.2468 W] 1 times daily at 10 meters resolution.

### 1.1 [#2] Visual imagery collection
The satellite shall provide for collection by the ground system visual imagery of MathWorks headquarters 1 times daily at 10 meters resolution.

#### 1.1.1 [#10] Orbit Selection
The Cubesat shall have ground coverage of [ 42.2775 N, 71.2468 W]

#### 1.1.2 [#11] CubeSat
The cubesat shall provide for collection by the ground system visual imagery of MathWorks headquarters 1 times daily at 10 meters resolution.

##### 1.1.2.1 [#4] Imaging payload performance
The imaging payload shall collect visual imagery at TBD2 meters resolution from a distance of TBD3 km with atmospheric conditions as specified in TBS1.

##### 1.1.2.2 [#5] GNC pointing accuracy
The GNC system shall point the imaging payload at a specified ground coordinate location with accuracy of TBD4 degrees.

##### 1.1.2.3 [#6] GNC slew rate
The attitude control subsystem shall be capable of slewing the spacecraft at TBD8 deg/sec.

##### 1.1.2.4 [#7] Image downlink
The communications subsystem shall downlink visual imagery to the ground.

##### 1.1.2.5 [#8] On-board image management
The CDHS shall collect visual imagery from the imaging payload and store it for ground downlink.

##### 1.1.2.6 [#23] Power for on-board imaging tasks
The electrical power system shall provide power to bus and imaging payload equipment accounting for eclipse durations of [eclipseDuration:TBD6] minutes per [orbitTime:TBD7] minute orbit.

###### 1.1.2.6.1 [#24] Power System Control
The Power System shall be able to control the power of the CubeSat.

###### 1.1.2.6.2 [#25] Power System Plant
The Power System shall contain both a solar array system for energy generation

###### 1.1.2.6.2.1 [#26] Solar Panel
The Solar Panel shall generate power using a grid of photovoltaic cells

###### 1.1.2.6.2.1.1 [#28] Solar Panel Cells
The Solar Panel Cells shall generate [PVPowerGen:3] W

###### 1.1.2.6.2.2 [#27] Battery
The battery sahll be created from a grid of battery cells.

###### 1.1.2.6.2.2.1 [#29] Battery Cell
The Battery cells shall be the main energy storage device

### 1.2 [#3] Visual imagery ground storage
The ground segment shall collect and store visual imagery provided by the satellite.